# Grasshopper definition Living Loop Generator.ghx (Grasshopper 1.0.7)

# ----
# Settings
gap_count = Slider(4, range=2..20)
loop_count = Slider(24, range=3..100)
gap_size = Slider(4, range=0..10)

# ----
# Curve A
crv = Curve(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)

# ----
# Curve B
crv_2 = Curve(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)

# ----
# Optional step for optimising input curves.
# Smoothes the curves out and matches the control point count,
# but as a result also alters these curves to some degree.
# You can disable this step with a toggle to the right
# if you want more precision.
cp = ControlPoints(Curve=crv_2)  # -> Points, Weights, Knots
cp_2 = ControlPoints(Curve=crv)  # -> Points, Weights, Knots
lng = ListLength(List=cp.Points)
lng_2 = ListLength(List=cp_2.Points)
max = Maximum(A=lng_2, B=lng)
reb = RebuildCurve(Curve=crv, Count=max, Tangents=False)
reb_2 = RebuildCurve(Curve=crv_2, Count=max, Tangents=False)
optimize_curves = BooleanToggle(False)
filter = StreamFilter(Gate=optimize_curves, Stream0=crv, Stream1=reb)
filter_2 = StreamFilter(Gate=optimize_curves, Stream0=crv_2, Stream1=reb_2)

subtraction = Subtraction(A=loop_count, B=1)
curve_a_seam_shift = Slider(0, range=0..1)
division = Division(A=1, B=subtraction)
num = Number(loop_count)
seam = Seam(Curve=reparameterize(filter), Seam=curve_a_seam_shift)

# ----
# Ideally the two input curves
# should have seams (end points)
# at the same side.
# If not, use this slider
# to adjust the curve seams until they match.
curve_b_seam_shift = Slider(0, range=0..1)
crv_3 = Curve(filter_2)
seam_2 = Seam(Curve=reparameterize(crv_3), Seam=curve_b_seam_shift)
end = EndPoints(Curve=[seam_2, seam])  # -> Start, End

series = Series(Start=0, Step=division, Count=num)

# ----
# If the two input curves have different directions
# (i.e. one is clockwise the other anti-clockwise)
# then the resulting hinge pattern can get all messed up.
# Use this setting to flip one curve and see if it gets better.
flip_cuve = BooleanToggle(True)
flip = FlipCurve(Curve=seam_2)  # -> Curve, Flag
filter_3 = StreamFilter(Gate=flip_cuve, Stream0=seam_2, Stream1=flip.Curve)

# ----
# Loop Distribution
graph = GraphMapper(
    series,
    x0=0,
    x1=1,
    y0=0,
    y1=1,
    container_name="Bezier",
    cpx=[0, 0.2854410708, 0.8253501058, 1],
    cpy=[0, 0.1221001744, 0.7085987329, 1])

multiplication = Multiplication(A=gap_count, B=2)
tweencrv = TweenCurve(CurveA=seam, CurveB=filter_3, Factor=graph, BlendType=0)
series_2 = Series(Start=0, Step=1, Count=num)
divide = DivideCurve(Curve=tweencrv, Count=multiplication, Kinks=False)  # -> Points, Tangents, Parameters
eval = Evaluate(F="x%2=0", x=series_2)
num_2 = Number(graft(eval))
shift = ShiftList(List=divide.Points, Shift=num_2, Wrap=True)  # -> simplify(List)
neg = Negative(Value=gap_size)
graft = GraftTree(Tree=tweencrv, IncludeEmptyLists=True, IncludeNullItems=True)
dispatch = Dispatch(List=shift, DispatchPattern=[True, False])  # -> ListA, ListB
# Hi, I'm Stepa and I made this thing. If you have and question or just want to reach out feel free to contact me at: st.drunks@gmail.com or at www.drunks.st
division_2 = Division(A=neg, B=2)
crv_cp = CurveClosestPoint(Point=dispatch.ListA, Curve=graft)  # -> Point, Parameter, Distance
shatter = Shatter(Curve=graft, Parameters=crv_cp.Parameter)
ext = ExtendCurve(Curve=shatter, Type=0, Start=division_2, End=division_2)
join = JoinCurves(Curves=ext, Preserve=False)

# ----
# Output
crv_4 = Curve(join)

preview = CustomPreview(Geometry=crv_4, Material=ColourSwatch(SwatchColor=RGB(0, 0, 0)))
